# Grasshopper definition DifferentialGrowth.gh (Grasshopper 1.0.7)
# Copyright: Liljewall Arkitekter
# plug-ins: Anemone, Weaverbird, Kangaroo2 Components

# ----
# Sphere as an input
number_slider = Slider(5, range=1..5)
msphereex = MeshSphereEx(Base=PlaneXY(0, 0, 0), Radius=number_slider, Count=5)

# ----
# Box as an Input
number_slider_2 = Slider(5, range=1..5)
pt = ConstructPoint(XCoordinate=number_slider_2, YCoordinate=0, ZCoordinate=0)
pt_2 = ConstructPoint(XCoordinate=0, YCoordinate=number_slider_2, ZCoordinate=number_slider_2)
box = Box2Pt(PointA=pt_2, PointB=pt, Plane=PlaneXY(0, 0, 0))

# ----
# Flat Surface as an input
number_slider_3 = Slider(10, range=0..10)
pt_3 = ConstructPoint(XCoordinate=0, YCoordinate=0, ZCoordinate=0)
circle = Circle(Plane=pt_3, Radius=number_slider_3)
pi = Pi(Factor=1)
boundary_surfaces = BoundarySurfaces(Edges=circle)
multiplication = Multiplication(A=Slider(0.01, range=0..1), B=pi)
rotate_axis = RotateAxis(Geometry=boundary_surfaces, Angle=multiplication, Axis=Line((0, 0, 0), (10, 0, 0)))  # -> Geometry, Transform
mesh = Mesh(rotate_axis.Geometry)
weaverbird_s_catmull_clark_subdivision = WeaverbirdsCatmullClarkSubdivision(MeshCurves=mesh, Level=1, SmoothNakedEdges=1)

# ----
# Option 2
number_slider_4 = Slider(5, range=0..100)
loop_start = LoopStart(Repeat=number_slider_4, Trigger=Toggle(False), Data=msphereex)  # -> port, Counter, Data
tri = Triangulate(Mesh=loop_start.Data)  # -> Mesh, Count
mesh_2 = Mesh(tri.Mesh)
data = Data("2")
python = GhPythonScript(Mesh=mesh_2, Length=data)  # -> out, a; inputs Mesh: Mesh
# ---------- python: Python ----------
__author__ = "carme"
__version__ = "2023.02.25"

import rhinoscriptsyntax as rs
import Rhino.Geometry as rg

for i in range(Mesh.TopologyEdges.Count):
    edges = Mesh.TopologyEdges.EdgeLine
    if edges(i).Length > 2:
        Mesh.TopologyEdges.SplitEdge(i,0.50)

a = Mesh
# ---------- end python ----------
mesh_3 = Mesh(python.a)
demesh = DeconstructMesh(Mesh=mesh_3)  # -> Vertices, Faces, Colours, Normals
medges = MeshEdges(Mesh=mesh_3)  # -> NakedEdges, InteriorEdges, NonManifoldEdges
geo = Geometry(mesh_3)
geo_2 = Geometry([medges.NakedEdges, medges.InteriorEdges, medges.NonManifoldEdges])
len = Length(Curve=geo_2)
multiplication_2 = Multiplication(A=len, B=Slider(1.2, range=0..5))
geo_3 = Geometry(demesh.Vertices)
cullpt = CullDuplicates(Points=geo_3, Tolerance=0.1, CullMode=3)  # -> Points, Indices, Valence
length_line = LengthLine(Line=geo_2, Length=multiplication_2, Strength=10)
show = Show(G=geo)
sc = SphereCollide(Points=cullpt.Points, Radius=1, Strength=1)
smooth = Smooth(M=mesh_3, Strength=Slider(40, range=0..100))
merge = Merge(Data1=show, Data2=length_line, Data3=sc, Data4=smooth)  # -> flatten(Result)
zombiesolver = ZombieSolver(GoalObjects=merge, Threshold=1e-10, Tolerance=0.01, MaxIterations=Slider(0, range=0..1000))  # -> I, V, O
mesh_4 = Mesh(zombiesolver.O)
clean = CleanTree(RemoveNulls=True, RemoveInvalid=True, RemoveEmpty=True, Tree=mesh_4)
mesh_5 = Mesh(clean)
loop_end = LoopEnd(port=loop_start.port, Exit=False, Data=mesh_5, TimeOutVal=0, pausedState=False, state="Constant output")
mesh_6 = Mesh(loop_end)
wbcatmullclark = WeaverbirdsCatmullClarkSubdivision(MeshCurves=mesh_6, Level=1, SmoothNakedEdges=1)  # disabled
preview = CustomPreview(Geometry=mesh_6, Material=ColourSwatch(SwatchColor=RGBA(201, 201, 201, 196)))

# ----
# Option 1
number_slider_5 = Slider(5, range=0..100)
loop_start_2 = LoopStart(Repeat=number_slider_5, Trigger=Toggle(True), Data=box)  # -> port, Counter, Data
tri_2 = Triangulate(Mesh=loop_start_2.Data)  # -> Mesh, Count
mesh_7 = Mesh(tri_2.Mesh)
data_2 = Data("2")
python_2 = GhPythonScript(Mesh=mesh_7, Length=data_2)  # -> out, a; inputs Mesh: Mesh; same code as python
mesh_8 = Mesh(python_2.a)
demesh_2 = DeconstructMesh(Mesh=mesh_8)  # -> Vertices, Faces, Colours, Normals
medges_2 = MeshEdges(Mesh=mesh_8)  # -> NakedEdges, InteriorEdges, NonManifoldEdges
geo_4 = Geometry(mesh_8)
geo_5 = Geometry([medges_2.NakedEdges, medges_2.InteriorEdges, medges_2.NonManifoldEdges])
len_2 = Length(Curve=geo_5)
geo_6 = Geometry(demesh_2.Vertices)
cullpt_2 = CullDuplicates(Points=geo_6, Tolerance=0.1, CullMode=3)  # -> Points, Indices, Valence
multiplication_3 = Multiplication(A=len_2, B=Slider(1.2, range=0..5))
sc_2 = SphereCollide(Points=cullpt_2.Points, Radius=1, Strength=1)
smooth_2 = Smooth(M=mesh_8, Strength=Slider(40, range=0..100))
length_line_2 = LengthLine(Line=geo_5, Length=multiplication_3, Strength=10)
show_2 = Show(G=geo_4)
merge_2 = Merge(Data1=show_2, Data2=length_line_2, Data3=sc_2, Data4=smooth_2)  # -> flatten(Result)
zombiesolver_2 = ZombieSolver(GoalObjects=merge_2, Threshold=1e-10, Tolerance=0.01, MaxIterations=Slider(0, range=0..1000))  # -> I, V, O
mesh_9 = Mesh(zombiesolver_2.O)
clean_2 = CleanTree(RemoveNulls=True, RemoveInvalid=True, RemoveEmpty=True, Tree=mesh_9)
mesh_10 = Mesh(clean_2)
loop_end_2 = LoopEnd(port=loop_start_2.port, Exit=False, Data=mesh_10, TimeOutVal=0, pausedState=False, state="Constant output")
mesh_11 = Mesh(loop_end_2)
preview_2 = CustomPreview(Geometry=mesh_11, Material=ColourSwatch(SwatchColor=RGBA(201, 201, 201, 196)))

# ----
# Option 3
number_slider_6 = Slider(1, range=0..100)
loop_start_3 = LoopStart(Repeat=number_slider_6, Trigger=Toggle(False), Data=weaverbird_s_catmull_clark_subdivision)  # -> port, Counter, Data
mesh_12 = Mesh(loop_start_3.Data)
data_3 = Data("2")
python_3 = GhPythonScript(Mesh=mesh_12, Length=data_3)  # -> out, a; inputs Mesh: Mesh; same code as python
medges_3 = MeshEdges(Mesh=python_3.a)  # -> NakedEdges, InteriorEdges, NonManifoldEdges
mesh_13 = Mesh(python_3.a)
medges_4 = MeshEdges(Mesh=mesh_13)  # -> NakedEdges, InteriorEdges, NonManifoldEdges
geo_7 = Geometry(mesh_13)
demesh_3 = DeconstructMesh(Mesh=mesh_13)  # -> Vertices, Faces, Colours, Normals
geo_8 = Geometry(medges_4.NakedEdges)
len_3 = Length(Curve=geo_8)
geo_9 = Geometry(demesh_3.Vertices)
cullpt_3 = CullDuplicates(Points=geo_9, Tolerance=0.1, CullMode=1)  # -> Points, Indices, Valence
multiplication_4 = Multiplication(A=len_3, B=Slider(0.91, range=0..5))
smooth_3 = Smooth(M=mesh_13, Strength=Slider(20, range=0..100))
length_line_3 = LengthLine(Line=geo_8, Length=multiplication_4, Strength=Slider(1, range=0..1))
show_3 = Show(G=geo_7)
sc_3 = SphereCollide(Points=cullpt_3.Points, Radius=1, Strength=Slider(0.76, range=0..1))
merge_3 = Merge(Data1=show_3, Data2=length_line_3, Data3=sc_3, Data4=smooth_3)  # -> flatten(Result)
zombiesolver_3 = ZombieSolver(GoalObjects=merge_3, Threshold=1e-10, Tolerance=0.01, MaxIterations=Slider(0, range=0..1000))  # -> I, V, O
mesh_14 = Mesh(zombiesolver_3.O)
clean_3 = CleanTree(RemoveNulls=True, RemoveInvalid=True, RemoveEmpty=True, Tree=mesh_14)
mesh_15 = Mesh(clean_3)
loop_end_3 = LoopEnd(port=loop_start_3.port, Exit=False, Data=mesh_15, TimeOutVal=0, pausedState=False, state="Constant output")
mesh_16 = Mesh(loop_end_3)
wbcatmullclark_2 = WeaverbirdsCatmullClarkSubdivision(MeshCurves=mesh_16, Level=1, SmoothNakedEdges=1)
preview_3 = CustomPreview(Geometry=wbcatmullclark_2, Material=ColourSwatch(SwatchColor=RGBA(201, 201, 201, 196)))
